# Grasshopper definition RayTracing_01.gh (Grasshopper 0.9.76)
# plug-ins: Python Interpreter

number_slider = Slider(10, range=0..100)
pt = ConstructPoint(XCoordinate=number_slider, YCoordinate=number_slider, ZCoordinate=number_slider)
geo = Geometry(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)
python = PythonScript(G=geo, n=Slider(1, range=1..1000), SP=pt)  # -> RayVec, SP, CS, Faces, SurfPoints; inputs G: Brep, n: Int32, SP: Point3d
# ---------- python: Python ----------
import random
import math
import rhinoscriptsyntax as rs
import Rhino as rc
    
    
"""Ray Vector Points"""
def RayPoints(theta,phi):
    point=rs.AddPoint(math.sin(theta)*math.cos(phi), math.sin(theta)*math.sin(phi), math.cos(theta))
    return point
    
    
"""Ray Vector Origo Points"""
def OrigoPoints(x,y,z):
    point=rs.AddPoint(x,y,z)
    return point
    
    
"""Ray Vectors between Ray Vector Points and Origo"""
def RayVectors(RayPoints,OrigoPoints):
    Vector=rs.VectorCreate(RayPoints,OrigoPoints)
    return Vector
    
    
"""RayVectors"""
RayVec=[]
#print range(int(n))
for i in range (n):
    
    theta = random.uniform(0,(2*math.pi))  
    phi = random.uniform(0,(2*math.pi))
    
    x = 0
    y = 0
    z = 0
    
    RayVec.append(RayVectors(RayPoints(theta,phi),OrigoPoints(x,y,z)))

#print RayVec


"""Testing weither source point is contained within Geometry"""
CS = G.IsPointInside(SP,0.01,True)

"""Number of Surfaces in Geometry"""
F=G.Surfaces.Count

"""Extracting Surfaces from Geometry"""
Faces=[]
def faces(f):
    faces=G.Faces.ExtractFace(f)
    return faces
    
for f in range (F):
    
    Faces.append(faces(f))
    
print Faces

SurfPoints=[]
def SurfacePoints(f):
    point=rs.SurfaceAreaCentroid(Faces[f])
    return point[0]

print range (int(F))
for f in range (F):
    
    SurfPoints.append(SurfacePoints(f))
    
print SurfPoints
# ---------- end python ----------
vdis = VectorDisplay(Anchor=python.SP, Vector=python.RayVec)
panel = Panel(python.CS)
pt_2 = Point(python.SurfPoints)
panel_2 = Panel(python.SurfPoints)
srf = Surface(python.Faces)
panel_3 = Panel(srf)
